# Grasshopper definition BeamAnalysis.gh (Grasshopper 1.0.7)
# plug-ins: Mice

h_shape = MakeHShapeModel(
    Width=Slider(200, range=0..1000),
    Height=Slider(400, range=0..1000),
    WebThickness=Slider(8, range=0..10),
    FlangeThickness=Slider(13, range=0..100),
    F=Slider(235, range=0..1000),
    Length=Slider(6300, range=0..10000))  # -> AnalysisParametar, ViewModelSurface
trapezoid_l = TrapezoidLoad(
    AnalysisParametar=h_shape.AnalysisParametar,
    TrapezoidLoad=Slider(10, range=0..10),
    DWidth=Slider(1800, range=0..10000),
    Lb=Slider(1800, range=0..10000),
    YoungsModulus=Slider(205000, range=0..1000000))  # -> BendingMoment, BendingStress, AllowableBendingStress, ExaminationResult, Deformation
panel = Panel([trapezoid_l.BendingStress, trapezoid_l.AllowableBendingStress, trapezoid_l.ExaminationResult, trapezoid_l.Deformation])
moment = MomentView(Moment=trapezoid_l.BendingMoment, Scale=Slider(20, range=0..100))
