# Grasshopper definition ResponseAnalysis.gh (Grasshopper 1.0.7)
# plug-ins: Mice

number_slider = Slider(1000, range=0..1000)
number_slider_2 = Slider(0.02, range=0..0.1)
number_slider_3 = Slider(0.2, range=0..1)
number_slider_4 = Slider(501, range=0..10000)
number_slider_5 = Slider(0.05, range=0..0.1)
kttom = CalcMFromKT(Stiffness=number_slider, NaturalPeriod=Slider(1.5, range=0..5))
_1dof_ra = _1dofResponseAnalysis(
    Mass=kttom,
    Stiffness=number_slider,
    DampingRatio=number_slider_5,
    TimeIncrement=number_slider_2,
    Beta=number_slider_3,
    N=number_slider_4,
    Wave="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")  # -> Model, Acceleration, Velocity, Displacement, TotalE, InternalE, KineticE, PotentialE
dom = ConstructDomain(DomainStart=Slider(0.05, range=0..0.1), DomainEnd=Slider(5, range=0..10))
spectrum = ResponseSpectrum(
    Range=dom,
    Division=Slider(1000, range=0..10000),
    DampingRatio=number_slider_5,
    TimeIncrement=number_slider_2,
    Beta=number_slider_3,
    N=number_slider_4,
    Wave="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")  # -> Acceleration, Velocity, Displacement, Energy

# ---- group: Acceleration
graph = QuickGraph(_1dof_ra.Acceleration, SortOrder=0)

# ---- group: Energy
graph_2 = QuickGraph([_1dof_ra.TotalE, _1dof_ra.InternalE, _1dof_ra.KineticE, _1dof_ra.PotentialE], SortOrder=0)

# ----
graph_3 = QuickGraph(spectrum.Energy, SortOrder=0)
graph_4 = QuickGraph(spectrum.Displacement, SortOrder=0)
graph_5 = QuickGraph(spectrum.Acceleration, SortOrder=0)
graph_6 = QuickGraph(spectrum.Velocity, SortOrder=0)
